# Grasshopper definition flatten_kangeroo.gh (Grasshopper 1.0.7)
# plug-ins: LunchBox, Kangaroo2 Components

srf = Surface(<surface referenced from the Rhino model>)
edges = BrepEdges(Brep=srf)  # -> Naked, Interior, NonManifold
graft = GraftTree(Tree=edges.Naked, IncludeEmptyLists=True, IncludeNullItems=True)
hex = HexagonCells(Surface=srf, UDivisions=Slider(15, range=0..100), VDivisions=Slider(16, range=0..100), TParameter=0.25)  # -> HexagonCells, Centers
planar = Planar(Curve=hex.HexagonCells)  # -> Planar, Plane, Deviation
explode = Explode(Curve=hex.HexagonCells, Recursive=True)  # -> flatten(Segments), Vertices
cp = ControlPoints(Curve=hex.HexagonCells)  # -> Points, Weights, Knots
divide = DivideCurve(Curve=graft, Count=10, Kinks=False)  # -> Points, Tangents, Parameters
dupln = RemoveDuplicateLines(Lines=explode.Segments, Tolerance=0.01)
flatten = FlattenTree(Tree=cp.Points, Path="{0}")
duppt = RemoveDuplicatePts(Points=flatten, Tolerance=0.01)
show = Show(G=hex.HexagonCells)
crv_cp = CurveClosestPoint(Point=duppt, Curve=graft)  # -> Point, Parameter, Distance
length_line = LengthLine(Line=dupln, Strength=Slider(0.768, range=0..1))
coplanar = CoPlanar(Points=cp.Points, Strength=Slider(690, range=0..1000))
equals = Equality(FirstNumber=crv_cp.Distance, SecondNumber=0)  # -> Equality, Inequality
oncurve = OnCurve(Points=crv_cp.Point, Curve=graft, Strength=Slider(297, range=0..1000))
cull = CullPattern(List=crv_cp.Point, CullPattern=equals.Equality)
merge = Merge(Data1=show, Data2=length_line, Data3=coplanar, Data4=oncurve)
flatten_2 = FlattenTree(Tree=merge, Path="{0}")
solver = Solver(GoalObjects=flatten_2, Reset=Button(), Threshold=1e-15, Tolerance=0.01, On=Toggle(True))  # -> I, V, graft(O)
panel = Panel(solver.O)
item = ListItem(List=solver.O, Index=Slider(51, range=0..100), Wrap=True)
boundary = BoundarySurfaces(Edges=solver.O)
viewer = ParamViewer(solver.O)
crv = Curve(solver.O)
planar_2 = IsPlanar(Surface=boundary, Interior=True)  # -> Planar, Plane
