# Grasshopper definition parawall.gh (Grasshopper 1.0.7)

crv = Curve(<curve referenced from the Rhino model>)
number_slider = Slider(26, range=0..100)
srf = Surface(<surface referenced from the Rhino model>)
pt = ConstructPoint(XCoordinate=0, YCoordinate=0, ZCoordinate=0)
neg = Negative(Value=Slider(16, range=0..40))

# ----
# Segment Surface
number_slider_2 = Slider(2, range=0..10)
Z = UnitZ(Factor=number_slider_2)
pl_offset = PlaneOffset(BasePlane=PlaneXY(0, 0, 0), Offset=1)
move = Move(Geometry=pl_offset, Motion=Vector(0, 0, 10))  # -> Geometry, Transform
arrlinear = LinearArray(Geometry=pl_offset, Direction=Z, Count=Slider(21, range=0..100))  # -> Geometry, Transform
sec = BrepPlane(Brep=srf, Plane=arrlinear.Geometry)  # -> flatten(Curves), Points

pt_2 = ConstructPoint(XCoordinate=0, YCoordinate=neg, ZCoordinate=0)
ln = Line(StartPoint=pt, EndPoint=pt_2)
num = Number(2)
X = UnitX(Factor=1)
Z_2 = UnitZ(Factor=1)
move_2 = Move(Geometry=pt, Motion=Z_2)  # -> Geometry, Transform
X_2 = UnitX(Factor=num)
move_3 = Move(Geometry=move_2.Geometry, Motion=X)  # -> Geometry, Transform
arrlinear_2 = LinearArray(Geometry=ln, Direction=X_2, Count=number_slider)  # -> Geometry, Transform
arrlinear_3 = LinearArray(Geometry=move_3.Geometry, Direction=X_2, Count=number_slider)  # -> Geometry, Transform
clx = CurveLine(Curve=crv, Line=arrlinear_2.Geometry, LimitFirst=True)  # -> Points, Params, Count
box = Box2Pt(PointA=arrlinear_3.Geometry, PointB=clx.Points, Plane=PlaneXY(0, 0, 0))

neg_2 = Negative(Value=Slider(2, range=0..10))
vec = VectorXYZ(XComponent=Slider(1, range=0..10), YComponent=neg_2, ZComponent=Slider(0, range=0..10))  # -> Vector, Length
neg_3 = Negative(Value=Slider(3, range=0..10))
vec_2 = VectorXYZ(XComponent=Slider(2, range=0..10), YComponent=neg_3, ZComponent=Slider(9, range=0..10))  # -> Vector, Length
move_4 = Move(Geometry=pt, Motion=vec.Vector)  # -> Geometry, Transform
move_5 = Move(Geometry=pt, Motion=vec_2.Vector)  # -> Geometry, Transform
box_2 = Box2Pt(PointA=move_4.Geometry, PointB=move_5.Geometry, Plane=PlaneXY(0, 0, 0))
Y = UnitY(Factor=Slider(5, range=0..10))
arrlinear_4 = LinearArray(Geometry=box_2, Direction=X_2, Count=number_slider)  # -> Geometry, Transform
neg_4 = Negative(Value=Y)
arrlinear_5 = LinearArray(Geometry=arrlinear_4.Geometry, Direction=neg_4, Count=Slider(2, range=0..10))  # -> Geometry, Transform

eval = EvaluateCurve(Curve=sec.Curves, Parameter=Slider(34, range=0..100))  # -> Point, Tangent, Angle
Y_2 = UnitY(Factor=1)
move_6 = Move(Geometry=eval.Point, Motion=Y_2)  # -> Geometry, Transform
ln_2 = Line(StartPoint=move_6.Geometry, EndPoint=eval.Point)
vec_3 = VectorXYZ(XComponent=Slider(1, range=0..10), YComponent=Slider(10, range=0..10), ZComponent=Slider(1, range=0..10))  # -> Vector, Length
divide = DivideCurve(Curve=sec.Curves, Count=Slider(18, range=0..100), Kinks=False)  # -> Points, Tangents, Parameters
move_7 = Move(Geometry=divide.Points, Motion=vec_3.Vector)  # -> Geometry, Transform
box_3 = Box2Pt(PointA=move_7.Geometry, PointB=divide.Points, Plane=PlaneXY(0, 0, 0))
merge = Merge(Data1=box, Data2=arrlinear_5.Geometry)
